# Grasshopper definition test.gh (Grasshopper 0.9.76)
# plug-ins: Firefly.X

dom = ConstructDomain(DomainStart=0, DomainEnd=Slider(399, range=0..1000))
rectangle = Rectangle(Plane=PlaneXY(0, 0, 0), XSize=dom, YSize=dom, Radius=0)  # -> Rectangle, Length
pop2d = Populate2D(Region=rectangle.Rectangle, Count=Slider(48, range=0..100), Seed=Slider(36, range=0..100))
pt = Point(<point referenced from the Rhino model>)
pdecon = Deconstruct(Point=pt)  # -> graft(XComponent), graft(YComponent), graft(ZComponent)
merge = Merge(Data1=pdecon.XComponent, Data2=pdecon.YComponent, Data3=pdecon.ZComponent)
join = TextJoin(Text=merge, Join=",")  # -> flatten(Result)
join_2 = TextJoin(Text=join, Join="&")
panel = Panel(join_2)
osc_sender = OSCSender(Data=join_2, IPAddressOfUDPServer="127.0.0.1", UDPPort="419")
