# Grasshopper definition uglybainan.gh (Grasshopper 1.0.4)
# plug-ins: Python Interpreter, LunchBox

unit_z = UnitZ(Factor=1)
multiplication = Multiplication(A=Slider(600, range=0..1000), B=unit_z)
geometry = Geometry(<brep referenced from the Rhino model>)
unit_z_2 = UnitZ(Factor=1)
geometry_2 = Geometry(<curve referenced from the Rhino model>)
geometry_3 = Geometry(<curve referenced from the Rhino model>)
dimensions = Dimensions(Surface=geometry)  # -> UDimension, VDimension; disabled
xy_plane = XYPlane(Origin=Point(0, 0, 0))
control_points = ControlPoints(Curve=geometry_2)  # -> Points, Weights, Knots
multiplication_2 = Multiplication(A=Slider(40, range=0..100), B=unit_z_2)
circle = Circle(Plane=xy_plane, Radius=Slider(200, range=0..1000))
extrude = Extrude(Base=circle, Direction=multiplication)
rectangle = Rectangle(Plane=PlaneXY(0, 0, 0), XSize=dimensions.UDimension, YSize=dimensions.VDimension, Radius=0)  # -> Rectangle, Length; disabled
geometry_4 = Geometry(control_points.Points)
face = Geometry(<brep referenced from the Rhino model>)
number_slider = Slider(10, range=0..10)
move = Move(Geometry=circle, Motion=multiplication_2)  # -> Geometry, Transform; disabled
panel = Panel(face)
divide_curve = DivideCurve(Curve=circle, Count=number_slider, Kinks=False)  # -> Points, Tangents, Parameters; disabled
divide_curve_2 = DivideCurve(Curve=move.Geometry, Count=number_slider, Kinks=False)  # -> Points, Tangents, Parameters; disabled
extrude_2 = Extrude(Base=circle, Direction=multiplication_2)
number_slider_2 = Slider(0, range=0..100)
series = Series(Start=0, Step=2, Count=5)
series_2 = Series(Start=1, Step=2, Count=5)
python_script = PythonScript()  # -> Out, A
domain = Domain()
list_item = ListItem(List=divide_curve.Points, Index=series, Wrap=True)
list_item_2 = ListItem(List=divide_curve_2.Points, Index=series_2, Wrap=True)
panel_2 = Panel(list_item)
panel_3 = Panel(list_item_2)
series_3 = Series(Start=Slider(1, range=0..100), Step=Slider(1, range=0..1), Count=Slider(5, range=0..10))
path_mapper = PathMapper(source="{A}(n)", target="{(A+1)/2}(n/2)")
number_slider_3 = Slider(0.6, range=0..1)

series_4 = Series(Start=Slider(1, range=0..100), Step=Slider(1, range=0..1), Count=Slider(24, range=0..30))

boolean_toggle = BooleanToggle(True)
insert_items = InsertItems(List=panel_2, Item=list_item_2, Indices=series_3, Wrap=True)
deconstruct = Deconstruct(Point=insert_items)  # -> XComponent, YComponent, ZComponent
series_5 = Series(Start=0, Step=2, Count=10)
multiplication_3 = Multiplication(A=number_slider_3, B=deconstruct.XComponent)
multiplication_4 = Multiplication(A=number_slider_3, B=deconstruct.YComponent)
insert_items_2 = InsertItems(Wrap=True)
interpolate = Interpolate(Vertices=insert_items, Degree=3, Periodic=boolean_toggle, KnotStyle=1)  # -> Curve, Length, Domain
内圈纵坐标 = Slider(0.924, range=0..1)
multiplication_5 = Multiplication(A=deconstruct.ZComponent, B=内圈纵坐标)
construct_point = ConstructPoint(XCoordinate=multiplication_3, YCoordinate=multiplication_4, ZCoordinate=multiplication_5)
interpolate_2 = Interpolate(Vertices=construct_point, Degree=3, Periodic=boolean_toggle, KnotStyle=1)  # -> Curve, Length, Domain
loft = Loft(
    Curves=[interpolate.Curve, interpolate_2.Curve],
    Options={Adjust=False, Closed=False, LoftEnds=0, LoftSimp=0, LoftType=0, Rebuild=10, Refit=0.01})
unroll_brep = UnrollBrep(Brep=loft, JoinUnrolled=False)
deconstruct_brep = DeconstructBrep(Brep=unroll_brep)  # -> Faces, Edges, Vertices
list_item_3 = ListItem(List=deconstruct_brep.Vertices, Index=Slider(3, range=0..10), Wrap=True)
list_item_4 = ListItem(List=deconstruct_brep.Vertices, Index=Slider(0, range=0..100), Wrap=True)
distance = Distance(PointA=list_item_4, PointB=list_item_3)
series_6 = Series(Start=Slider(1, range=0..1), Step=Slider(1, range=0..1), Count=Slider(20, range=0..100))
number_slider_4 = Slider(0.5, range=0..1)
gene_pool = GenePool(Decimals=3, Maximum=1, Minimum=0, Value=[0.5, 0.534, 0.494, 0.481, 0.496, 0.528, 0.49, 0.5, 0.5, 0.5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])
series_7 = Series(Start=0, Step="0", Count="41")  # -> graft(Series)
panel_4 = Panel(series_7)
series_8 = Series(Start=Slider(1, range=0..100), Step=Slider(2, range=0..10), Count=Slider(24, range=0..30))
number_slider_5 = Slider(0.6, range=0..1)
galapagos = Galapagos(fitness=distance_2, gene=gene_pool)
construct_path = ConstructPath(Indices=panel_4)  # -> simplify(Branch)
unflatten_tree = UnflattenTree(Tree=gene_pool, Guide=construct_path)

series_9 = Series(Start=Slider(1, range=0..1), Step=Slider(1, range=0..1), Count=Slider(24, range=0..30))

panel_5 = Panel(unflatten_tree)
gene_pool_2 = GenePool(Decimals=3, Maximum=1, Minimum=0, Value=[0.5, 0.51, 0.51, 0.51, 0.67, 0.37, 0.49, 0.5, 0.5, 0.5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])
series_10 = Series(Start=0, Step="0", Count="41")  # -> graft(Series)
series_11 = Series(Start=0, Step="0", Count="5")
panel_6 = Panel(series_11)
panel_7 = Panel(series_10)
addition = Addition(A=series_10, B=series_11)  # -> graft(Result)
construct_path_2 = ConstructPath(Indices=addition)  # -> simplify(Branch)
unflatten_tree_2 = UnflattenTree(Tree=gene_pool_2, Guide=construct_path_2)
panel_8 = Panel(unflatten_tree_2)
panel_9 = Panel(addition)
shift_paths = ShiftPaths(Data=unflatten_tree_2, Offset=-1)
panel_10 = Panel(shift_paths)
integer = Integer(shift_paths)
panel_11 = Panel(integer)

# ---- group: copy
unit_z_3 = UnitZ(Factor=1)
python_script_2 = PythonScript(x=Slider(10, range=0..10), y=Slider(0.5, range=0..1), z=Slider(41, range=0..100))  # -> out, a
# ---------- python_script_2: Python ----------
__author__ = "umida"

import rhinoscriptsyntax as rs




a = list();
a.append(0);
for i in range(0,41):
  h = (20.0 + 0.25*i )*(i+1)/2;
  a.append(h);
# ---------- end python_script_2 ----------

# ----
multiplication_6 = Multiplication(A=Slider(0.566, range=0..1), B=python_script_2.a)

# ---- group: copy (continued)
multiplication_7 = Multiplication(A=multiplication_6, B=unit_z_3)
move_2 = Move(Geometry=circle, Motion=multiplication_7)  # -> Geometry, Transform

# ----
divide_curve_3 = DivideCurve(Curve=move_2.Geometry, Count=Slider(48, range=0..100), Kinks=False)  # -> Points, Tangents, Parameters
panel_12 = Panel(divide_curve_3.Points)
pdecon = Deconstruct(Point=panel_12)  # -> XComponent, YComponent, ZComponent
panel_13 = Panel(pdecon.ZComponent)
pt = ConstructPoint(XCoordinate=number_slider_2, YCoordinate=number_slider_2, ZCoordinate=pdecon.ZComponent)
ln = Line(StartPoint=panel_12, EndPoint=pt)
panel_14 = Panel(ln)
mcx = MeshCurve(Mesh=face, Curve=ln)  # -> Points, Faces
panel_15 = Panel(mcx.Points)
trim = TrimTree(Tree=mcx.Points, Depth=1)
vec2pt = Vector2Pt(PointA=panel_12, PointB=trim, Unitize=False)  # -> Vector, Length
move_3 = Move(Geometry=panel_12, Motion=vec2pt.Vector)  # -> Geometry, Transform

# ---- group: divide
cull_pattern = CullPattern(List=move_3.Geometry, CullPattern=[False, True])  # -> simplify(List)
cull_pattern_2 = CullPattern(List=move_3.Geometry, CullPattern=[True, False])
flip_matrix = FlipMatrix(Data=cull_pattern_2)
flip_matrix_2 = FlipMatrix(Data=cull_pattern)
cull_pattern_3 = CullPattern(List=flip_matrix, CullPattern=[True, False])
cull_pattern_4 = CullPattern(List=flip_matrix_2, CullPattern=[False, True])
flip_matrix_3 = FlipMatrix(Data=cull_pattern_4)
flip_matrix_4 = FlipMatrix(Data=cull_pattern_3)
geometry_5 = Geometry(flip_matrix_4)
geometry_6 = Geometry(flip_matrix_3)

# ----
panel_16 = Panel(cull_pattern)
panel_17 = Panel(geometry_6)
panel_18 = Panel(move_3.Geometry)
panel_19 = Panel(trim)
panel_20 = Panel(geometry_5)
flip_matrix_5 = FlipMatrix(Data=geometry_6)
flip_matrix_6 = FlipMatrix(Data=panel_20)
cull_pattern_5 = CullPattern(
    List=flip_matrix_5,
    CullPattern=[True, True, True, True, True, True, True, True, True, True, True, True, True, True, True, True, True, True, True, True, False])
cull_pattern_6 = CullPattern(
    List=flip_matrix_6,
    CullPattern=[False, True, True, True, True, True, True, True, True, True, True, True, True, True, True, True, True, True, True, True, True])
flip_matrix_7 = FlipMatrix(Data=cull_pattern_5)
panel_21 = Panel(flip_matrix_7)
flip_matrix_8 = FlipMatrix(Data=cull_pattern_6)
insert_items_3 = InsertItems(List=geometry_5, Item=geometry_6, Indices=series_4, Wrap=True)
shift = ShiftList(List=flip_matrix_8, Shift=Slider(1, range=0..1), Wrap=True)
insert_items_4 = InsertItems(List=flip_matrix_7, Item=shift, Indices=series_4, Wrap=True)
panel_22 = Panel(shift)
panel_23 = Panel(insert_items_3)
panel_24 = Panel(insert_items_4)
flip = FlipMatrix(Data=panel_23)
flip_2 = FlipMatrix(Data=panel_24)
ins = InsertItems(List=flip, Item=flip_2, Indices=series_6, Wrap=True)
flip_3 = FlipMatrix(Data=ins)
panel_25 = Panel(flip_3)
trim_tree = TrimTree(Tree=panel_25, Depth=3)
panel_26 = Panel(trim_tree)
intcrv = Interpolate(Vertices=panel_26, Degree=3, Periodic=True, KnotStyle=1)  # -> Curve, Length, Domain
panel_27 = Panel(intcrv.Curve)
deconstruct_2 = Deconstruct(Point=panel_26)  # -> XComponent, YComponent, ZComponent

series_12 = Series(Start=Slider(0, range=0..100), Step=Slider(2, range=0..10), Count=Slider(24, range=0..30))
item = ListItem(List=deconstruct_2.ZComponent, Index=series_12, Wrap=True)

panel_28 = Panel(deconstruct_2.ZComponent)
纵坐标较小值 = ListItem(List=deconstruct_2.ZComponent, Index=series_8, Wrap=True)
multiplication_8 = Multiplication(A=number_slider_4, B=deconstruct_2.XComponent)
multiplication_9 = Multiplication(A=number_slider_4, B=deconstruct_2.YComponent)
subtraction = Subtraction(A=纵坐标较小值, B=item)
panel_29 = Panel(item)
multiplication_10 = Multiplication(A=subtraction, B=unflatten_tree)
panel_30 = Panel(multiplication_10)
addition_2 = Addition(A=item, B=multiplication_10)
panel_31 = Panel(multiplication_8)
ins_2 = InsertItems(List=item, Item=addition_2, Indices=series_9, Wrap=True)
panel_33 = Panel(addition_2)
panel_34 = Panel(ins_2)
construct_point_2 = ConstructPoint(XCoordinate=multiplication_8, YCoordinate=multiplication_9, ZCoordinate=ins_2)
panel_35 = Panel(construct_point_2)
trim_tree_2 = TrimTree(Tree=panel_35, Depth=1)
intcrv_2 = Interpolate(Vertices=trim_tree_2, Degree=3, Periodic=True, KnotStyle=1)  # -> Curve, Length, Domain
loft_2 = Loft(
    Curves=[intcrv_2.Curve, intcrv.Curve],
    Options={Adjust=False, Closed=False, LoftEnds=0, LoftSimp=0, LoftType=0, Rebuild=10, Refit=0.01})
unroll_brep_2 = UnrollBrep(Brep=loft_2, JoinUnrolled=False)

deconstruct_brep_2 = DeconstructBrep(Brep=unroll_brep_2)  # -> Faces, Edges, Vertices
list_item_5 = ListItem(List=deconstruct_brep_2.Vertices, Index=Slider(3, range=0..10), Wrap=True)
list_item_6 = ListItem(List=deconstruct_brep_2.Vertices, Index=Slider(0, range=0..100), Wrap=True)
distance_2 = Distance(PointA=list_item_6, PointB=list_item_5)

panel_36 = Panel(distance_2)
panel_37 = Panel(trim_tree_2)
panel_38 = Panel(intcrv_2.Curve)
